# Grasshopper definition hydra-grasshopper_example.ghx (Grasshopper 0.9.64)

udp_port = Panel("5555")
deactivatesocket = Panel("-1")
filter = StreamFilter(Gate=Toggle(False), Stream0=deactivatesocket, Stream1=udp_port)
panel = Panel(filter)
# Get Oculus data from OpenTrack
opentrackudpparser = CSharpScript(port=panel)  # -> out, A, B, client; inputs port: Int32
# ---------- opentrackudpparser: C# ----------
    A = messageReceived;
    //B = BitConverter.ToDouble(messageBytes, 0);
    // B = BAToDouble(messageBytes, 0);
    B = values;

    //If we already had started receiving
    if(begunReceiving) {

      if(messageReceived) {
        //We set that message was collected
        messageReceived = false;
        Print("Value is updated...");
      } else {
        Print("Loop with no updates...");
      }

      if(port != listenPort){
        if(port == -1){
          StopReceiving();
          listenPort = port;
        } else {
          StopReceiving();
          if(ReceiveMessages(port)){
            listenPort = port;
          }
        }
      }
    }
      //Otherwise we need to start receiving...
    else {
      if(port > 0){
        listenPort = port;
        ReceiveMessages(port);
      } else {
        Print("Waiting for a port to listen to...");
      }
    }

    client = udpClient;
# ---------- opentrackudpparser: C# additional code ----------
  //Code example from http://msdn.microsoft.com/en-us/library/system.net.sockets.udpclient.beginreceive.aspx
  private System.Net.Sockets.UdpClient udpClient;
  private System.Net.IPEndPoint ip;

  private int listenPort = 0;
  private static bool begunReceiving = false;
  private volatile bool messageReceived = false;
  private volatile string messageText = null;
  private volatile double[] values = null;

  // Convert eight byte array elements to a double and display it.
  public string BAToDouble(byte[ ] bytes, int index)
  {
    double value = BitConverter.ToDouble(bytes, index);

    return BitConverter.ToString(bytes, index, 8);
  }

  private void ReceiveCallback(IAsyncResult ar) {
    try {
      if(udpClient != null){
        Byte[] receiveBytes = udpClient.EndReceive(ar, ref ip);
        //messageText = System.Text.Encoding.UTF8.GetBytes(receiveBytes);
        messageReceived = true;
        Print("Received " + messageText);
        if(values == null) values = new double[receiveBytes.Length / 8];
        for(int i = 0 ; i < values.Length ; i++) {
          values[i] = BitConverter.ToDouble(receiveBytes, i * 8);
        //  Print(values[i].ToString());
        }
        udpClient.BeginReceive(new AsyncCallback(ReceiveCallback), null);
      }
    } catch (Exception ex) {

      Print("Error in ReceiveCallback: " + ex.Message);

    }
  }

  private bool ReceiveMessages(int port) {
    try{

      //Change here the IP address
      //ip = new System.Net.IPEndPoint("192.168.1.6", port);
      ip = new System.Net.IPEndPoint(System.Net.IPAddress.Loopback, port);

      udpClient = new System.Net.Sockets.UdpClient(ip);

      udpClient.BeginReceive(new AsyncCallback(ReceiveCallback), null);

      begunReceiving = true;
      Print("Listening for messages");
      return true;

    } catch (System.Net.Sockets.SocketException ex) {

      if (ex.SocketErrorCode == System.Net.Sockets.SocketError.AddressAlreadyInUse){
        Print("Socket error: If you changed the C# window code without setting the port to -1, you will need to restart Rhino." + ex.Message + ".");
      }

    } catch (Exception ex){
      Print("Error: " + ex.Message);
    }

    return false;
  }

  private void StopReceiving(){
    try {
      if(udpClient != null){
        udpClient.Client.Shutdown(System.Net.Sockets.SocketShutdown.Both);
        udpClient.Close();
        udpClient = null;
      }
      begunReceiving = false;
      Print("Stopped receiving");
    } catch (Exception ex){
      Print("Error while stopping receiving: " + ex.Message);
    }
  }
# ---------- end opentrackudpparser ----------
network_info = Panel(opentrackudpparser.out)
opentrack_info = Panel(opentrackudpparser.B)
panel_2 = Panel("""TX
TY
TZ
YAW
PITCH
ROLL""")
oculus_data = Data(opentrackudpparser.B)

timer = Timer(TimerInterval=2, Target=opentrackudpparser)
multiplication = Multiplication(A=opentrackudpparser.B, B=Slider(1, range=0..10))
bang = ExplodeTree(Data=simplify(graft(multiplication)))  # -> Branch0, Branch1, Branch2, Branch3, Branch4, Branch5
neg = Negative(Value=bang.Branch2)
pt = ConstructPoint(XCoordinate=bang.Branch0, YCoordinate=neg, ZCoordinate=bang.Branch1)
rec = DataRecorder(pt, DataLimit=-10, RecordData=True)
colour = ColourPicker(PickedColour=RGB(32, 33, 30))
pline = PolyLine(Vertices=rec, Closed=False)
preview = CustomPreview(Geometry=pline, Shader=colour)
