# Grasshopper definition oculus-grasshopper_v0.1.gh (Grasshopper 0.9.64)

rightviewportname = Panel("RightEye")

leftviewportname = Panel("LeftEye")

# ----
# 4. This moves the camera based on Oculus movement.
# 3. Use this to set the desired camera, before turning Oculus Move on.
oculusmove = BooleanToggle(True)

ipd_mm = Panel("62.1")

# ----
# 2. This turns the UDP reader on.
readudp = BooleanToggle(True)

# ----
# 1. This offsets the LeftEye / RightEye viewports,
# and syncs their movement.
synceyes = BooleanToggle(True)

mmtoinches = MMtoINCHES(A=ipd_mm)
mmtometers = MMtoMETERS(A=ipd_mm)
mmtofeet = MMtoFEET(A=ipd_mm)
ipd_model_units = Number(mmtofeet)

udp_port = Panel("5554")
deactivatesocket = Panel("-1")
filter = StreamFilter(Gate=readudp, Stream0=deactivatesocket, Stream1=udp_port)
panel = Panel(filter)
opentrackudpparser = CSharpScript(port=panel)  # -> out, A, B, client; inputs port: Int32
# ---------- opentrackudpparser: C# ----------
    A = messageReceived;
    //B = BitConverter.ToDouble(messageBytes, 0);
    // B = BAToDouble(messageBytes, 0);
    B = values;

    //If we already had started receiving
    if(begunReceiving) {

      if(messageReceived) {
        //We set that message was collected
        messageReceived = false;
        Print("Value is updated...");
      } else {
        Print("Loop with no updates...");
      }

      if(port != listenPort){
        if(port == -1){
          StopReceiving();
          listenPort = port;
        } else {
          StopReceiving();
          if(ReceiveMessages(port)){
            listenPort = port;
          }
        }
      }
    }
      //Otherwise we need to start receiving...
    else {
      if(port > 0){
        listenPort = port;
        ReceiveMessages(port);
      } else {
        Print("Waiting for a port to listen to...");
      }
    }

    client = udpClient;
# ---------- opentrackudpparser: C# additional code ----------
  //Code example from http://msdn.microsoft.com/en-us/library/system.net.sockets.udpclient.beginreceive.aspx
  private System.Net.Sockets.UdpClient udpClient;
  private System.Net.IPEndPoint ip;

  private int listenPort = 0;
  private static bool begunReceiving = false;
  private volatile bool messageReceived = false;
  private volatile string messageText = null;
  private volatile double[] values = null;

  // Convert eight byte array elements to a double and display it.
  public string BAToDouble(byte[ ] bytes, int index)
  {
    double value = BitConverter.ToDouble(bytes, index);

    return BitConverter.ToString(bytes, index, 8);
  }

  private void ReceiveCallback(IAsyncResult ar) {
    try {
      if(udpClient != null){
        Byte[] receiveBytes = udpClient.EndReceive(ar, ref ip);
        //messageText = System.Text.Encoding.UTF8.GetBytes(receiveBytes);
        messageReceived = true;
        Print("Received " + messageText);
        if(values == null) values = new double[receiveBytes.Length / 8];
        for(int i = 0 ; i < values.Length ; i++) {
          values[i] = BitConverter.ToDouble(receiveBytes, i * 8);
        //  Print(values[i].ToString());
        }
        udpClient.BeginReceive(new AsyncCallback(ReceiveCallback), null);
      }
    } catch (Exception ex) {

      Print("Error in ReceiveCallback: " + ex.Message);

    }
  }

  private bool ReceiveMessages(int port) {
    try{

      //Change here the IP address
      //ip = new System.Net.IPEndPoint("192.168.1.6", port);
      ip = new System.Net.IPEndPoint(System.Net.IPAddress.Loopback, port);

      udpClient = new System.Net.Sockets.UdpClient(ip);

      udpClient.BeginReceive(new AsyncCallback(ReceiveCallback), null);

      begunReceiving = true;
      Print("Listening for messages");
      return true;

    } catch (System.Net.Sockets.SocketException ex) {

      if (ex.SocketErrorCode == System.Net.Sockets.SocketError.AddressAlreadyInUse){
        Print("Socket error: If you changed the C# window code without setting the port to -1, you will need to restart Rhino." + ex.Message + ".");
      }

    } catch (Exception ex){
      Print("Error: " + ex.Message);
    }

    return false;
  }

  private void StopReceiving(){
    try {
      if(udpClient != null){
        udpClient.Client.Shutdown(System.Net.Sockets.SocketShutdown.Both);
        udpClient.Close();
        udpClient = null;
      }
      begunReceiving = false;
      Print("Stopped receiving");
    } catch (Exception ex){
      Print("Error while stopping receiving: " + ex.Message);
    }
  }
# ---------- end opentrackudpparser ----------
network_info = Panel(opentrackudpparser.out)
opentrack_info = Panel(opentrackudpparser.B)
panel_2 = Panel("""TX
TY
TZ
YAW
PITCH
ROLL""")
oculus_data = Data(opentrackudpparser.B)

synceyesbool = Boolean(synceyes)
lefteye = Text(leftviewportname)
righteye = Text(rightviewportname)
# Sync Left/Right Camera Eyes
getnamedcamera = CSharpScript(Activate=synceyesbool, ViewportName=lefteye)  # -> Location, Target, Lens, Up; inputs Activate: Boolean, ViewportName: String
# ---------- getnamedcamera: C# ----------
    if(Activate) {
      foreach(Rhino.Display.RhinoView thisview in RhinoDoc.ActiveDoc.Views) {
        if (ViewportName == thisview.ActiveViewport.Name) {
          Print("we have a match");
          Print(thisview.ActiveViewport.CameraLocation.ToString());
          Location = thisview.ActiveViewport.CameraLocation;
          Target = thisview.ActiveViewport.CameraTarget;
          Lens = thisview.ActiveViewport.Camera35mmLensLength;
          Up = thisview.ActiveViewport.CameraUp;
        }
      }

    }
# ---------- end getnamedcamera ----------
ipd_model_units_2 = Number(ipd_model_units)
moveeye = MoveEye(
    location=getnamedcamera.Location,
    target=getnamedcamera.Target,
    lens=getnamedcamera.Lens,
    up=getnamedcamera.Up,
    num=ipd_model_units_2)  # -> G, G_2, lens_3, up_3
setnamedcamera = CSharpScript(
    Activate=synceyesbool,
    ViewportName=righteye,
    Location=moveeye.G,
    Target=moveeye.G_2,
    Lens=moveeye.lens_3,
    Up=moveeye.up_3)  # inputs Activate: Boolean, ViewportName: String, Location: Point3d, Target: Point3d, Lens: Double, Up: Vector3d
# ---------- setnamedcamera: C# ----------
    if(Activate) {
      foreach(Rhino.Display.RhinoView thisview in RhinoDoc.ActiveDoc.Views) {
        if (ViewportName == thisview.ActiveViewport.Name) {
          thisview.ActiveViewport.SetCameraLocations(Target, Location);
          thisview.ActiveViewport.Camera35mmLensLength = Lens;
          thisview.ActiveViewport.CameraUp = Up;
        }
      }
    }
# ---------- end setnamedcamera ----------

timer = Timer(TimerInterval=1, Target=[setnamedcamera, getnamedcamera, opentrackudpparser, getnamedcamera_2])

lefteye_2 = Text(leftviewportname)
getnamedcamera_2 = CSharpScript(Activate=oculusmove, ViewportName=lefteye_2)  # -> Location, Target, Lens, Up; inputs Activate: Boolean, ViewportName: String; same code as getnamedcamera
Z = UnitZ(Factor=1)
merge = Merge(Data1=getnamedcamera_2.Location, Data2=getnamedcamera_2.Target, Data3=getnamedcamera_2.Lens, Data4=getnamedcamera_2.Up)
datadongle = DataDongle(D=oculus_data)  # -> yaw_2, pitch_2, roll_2
rifttransform = RiftTransform(pt="0,0,0", D=datadongle.yaw_2, D_3=datadongle.pitch_2, D_2=datadongle.roll_2)
lefteye_3 = Text(lefteye)
bool = Boolean(oculusmove)

dam = DataDam(DataA=merge, BufferDelay=10000000, BufferMode=0)

bang = ExplodeTree(Data=graft(dam))  # -> Branch0, Branch1, Branch2, Branch3
# Move Camera
location = Point(bang.Branch0)
target = Data(bang.Branch1)
lens = Data(bang.Branch2)
up = Data(bang.Branch3)
rifttransform_2 = RiftTransform(pt=location, D=datadongle.yaw_2, D_3=datadongle.pitch_2, D_2=datadongle.roll_2)
transform = Transform(Geometry=target, Transform=rifttransform_2)
transform_2 = Transform(Geometry=up, Transform=rifttransform)
setnamedcamera_2 = CSharpScript(Activate=bool, ViewportName=lefteye_3, Location=location, Target=transform, Lens=lens, Up=transform_2)  # -> out; inputs Activate: Boolean, ViewportName: String, Location: Point3d, Target: Point3d, Lens: Double, Up: Vector3d; same code as setnamedcamera

# ==== cluster DataDongle
D = ClusterInput()
bang = ExplodeTree(Data=graft(D))  # -> Branch0, Branch1, Branch2, Branch3, Branch4, Branch5
yaw = Number(bang.Branch3)
roll = Number(bang.Branch5)
pitch = Number(bang.Branch4)
yaw_2 = ClusterOutput(yaw)
pitch_2 = ClusterOutput(pitch)
roll_2 = ClusterOutput(roll)

# ==== cluster MoveEye
location = ClusterInput()
target = ClusterInput()
lens = ClusterInput()
up = ClusterInput()
num = ClusterInput()
location_2 = Data(location)
target_2 = Data(target)
lens_2 = Data(lens)
up_2 = Data(up)
lens_3 = ClusterOutput(lens_2)
up_3 = ClusterOutput(up_2)
vec2pt = Vector2Pt(PointA=location_2, PointB=target_2, Unitize=False)  # -> Vector, Length
num_2 = Number(num)
xprod = CrossProduct(VectorA=vec2pt.Vector, VectorB=up_2, Unitize=False)  # -> Vector, Length
amp = Amplitude(Vector=xprod.Vector, Amplitude=num_2)
move = Move(Geometry=location_2, Motion=amp)  # -> Geometry, Transform
move_2 = Move(Geometry=target_2, Motion=amp)  # -> Geometry, Transform
G = ClusterOutput(move.Geometry)
G_2 = ClusterOutput(move_2.Geometry)

# ==== cluster RiftTransform
pt = ClusterInput()
# if standing at 0, 0, facing north (Y up):
# 
# YAW is rotation around Z axis
# Pitch is rotation around X axis
# Roll is rotation around Y axis
pt_2 = Point(pt)
D = ClusterInput()
D_2 = ClusterInput()
rad = Radians(Degrees=D)
D_3 = ClusterInput()
Z = UnitZ(Factor=1)
xy = XYPlane(Origin=Point(0, 0, 0))
rad_2 = Radians(Degrees=D_2)
rad_3 = Radians(Degrees=D_3)
rot3d = Rotate3D(Geometry=xy, Angle=rad, Center=pt_2, Axis=Z)  # -> Geometry, Transform
deplane = DeconstructPlane(Plane=rot3d.Geometry)  # -> Origin, XAxis, YAxis, ZAxis
neg = Negative(Value=rad_2)
rot3d_2 = Rotate3D(Geometry=rot3d.Geometry, Angle=rad_3, Center=pt_2, Axis=deplane.XAxis)  # -> Geometry, Transform
deplane_2 = DeconstructPlane(Plane=rot3d_2.Geometry)  # -> Origin, XAxis, YAxis, ZAxis
rot3d_3 = Rotate3D(Geometry=rot3d_2.Geometry, Angle=neg, Center=pt_2, Axis=deplane_2.YAxis)  # -> Geometry, Transform
orient = Orient(Source=xy, Target=rot3d_3.Geometry)  # -> Geometry, Transform
X = ClusterOutput(orient.Transform)

# ==== cluster MMtoINCHES
A = ClusterInput()
multiplication = Multiplication(A=A, B="0.0393700787")
R = ClusterOutput(multiplication)

# ==== cluster MMtoFEET
A = ClusterInput()
multiplication = Multiplication(A=A, B="0.0393700787")
division = Division(A=multiplication, B="12")
R = ClusterOutput(division)

# ==== cluster MMtoMETERS
A = ClusterInput()
multiplication = Multiplication(A=A, B="0.001")
R = ClusterOutput(multiplication)
